# Grasshopper definition 260402_기부채납 비율 검토 _ 타워.gh (Grasshopper 1.0.8)

# ----
# SITE AREA
panel = Panel("11570.63")

허용_용적률 = Slider(250, range=200..250)
타_법령에_의한_완화_용적 = Slider(36.5, range=5..50)
_59type_세대당_분양가 = Slider(9.5, range=7..10)
주거_평당_공사비 = Slider(0.8, range=0..1)
비주거_평당_공사비 = Slider(0.9, range=0..1.5)

# ----
# False _ 임대주택 기부채납
# True _ 건축물 기부채납
기부채납_건물_임대_선택 = BooleanToggle(False)

# ----
# 대지 기부채납 비율
대지_기부채납_비율 = Slider(15, range=5..15)

# ----
# 지상층 시설
panel_2 = Panel("1050")

# ----
# 전체 용적률
panel_3 = Panel("400")

# ----
# 토지비
panel_4 = Panel("16114000")

# ----
# 최소 순부담 15%
panel_5 = Panel("15")

# ----
# 임대주택 기부채납 공사비
panel_6 = Panel("1648836")

# ----
# 건축물 기부채납 공사비
panel_7 = Panel("4300000")

최고_높이 = Slider(81, range=70..115)
층고 = Slider(2.9, range=2.8..3.1)
# SITE
geometry = Geometry(<curve referenced from the Rhino model>)
# CUTTER
geometry_2 = Geometry(<curve referenced from the Rhino model>)
subtraction = Subtraction(A=panel_5, B=대지_기부채납_비율)

# ----
# 건축물 순부담비
panel_8 = Panel(subtraction)

division = Division(A=panel_5, _100=100)
division_2 = Division(A=panel_3, _100=100)

geometry_3 = Geometry(<curve referenced from the Rhino model>)
geometry_4 = Geometry(<curve referenced from the Rhino model>)
geometry_5 = Geometry(<curve referenced from the Rhino model>)
geometry_6 = Geometry(<curve referenced from the Rhino model>)
geometry_7 = Geometry(<curve referenced from the Rhino model>)
geometry_8 = Geometry(<curve referenced from the Rhino model>)
geometry_9 = Geometry(<curve referenced from the Rhino model>)
geometry_10 = Geometry(<curve referenced from the Rhino model>)
geometry_11 = Geometry(<curve referenced from the Rhino model>)
geometry_12 = Geometry(<curve referenced from the Rhino model>)
geometry_13 = Geometry(<curve referenced from the Rhino model>)
geometry_14 = Geometry(<curve referenced from the Rhino model>)
geometry_15 = Geometry(<curve referenced from the Rhino model>)
geometry_16 = Geometry(<curve referenced from the Rhino model>)
geometry_17 = Geometry(<curve referenced from the Rhino model>)
geometry_18 = Geometry(<curve referenced from the Rhino model>)
geometry_19 = Geometry(<curve referenced from the Rhino model>)
geometry_20 = Geometry(<curve referenced from the Rhino model>)
geometry_21 = Geometry(<curve referenced from the Rhino model>)
geometry_22 = Geometry(<curve referenced from the Rhino model>)
geometry_23 = Geometry(<curve referenced from the Rhino model>)
geometry_24 = Geometry(<curve referenced from the Rhino model>)
geometry_25 = Geometry(<curve referenced from the Rhino model>)
geometry_26 = Geometry(<curve referenced from the Rhino model>)
merge = Merge(Data1=geometry_23, Data2=geometry_24, Data3=geometry_25, Data4=geometry_26)  # -> flatten(Result)
merge_2 = Merge(
    Data1=geometry_3,
    Data2=geometry_4,
    Data3=geometry_5,
    Data4=geometry_6,
    Data5=geometry_7,
    Data6=geometry_8,
    Data7=geometry_9,
    Data8=geometry_10,
    Data9=geometry_11,
    Data10=geometry_12,
    Data11=geometry_13,
    Data12=geometry_14,
    Data13=geometry_15,
    Data14=geometry_16,
    Data15=geometry_17,
    Data16=geometry_18,
    Data17=geometry_19,
    Data18=geometry_20,
    Data19=geometry_21,
    Data20=geometry_22)

# ----
# SITE AREA
# Inputs:
# x: 부지 기부채납 대지면적
# A: 대지면적
# M: 공사비
# N: 토지비
# K: 용적률
# R: 기부채납 비율 (예: 15%일 경우 0.15 입력)
# Output:
#  y: 건축물 기부채납 면적
division_3 = Division(A=대지_기부채납_비율, _100=100)
subtraction_2 = Subtraction(A=1, B=division_3)
multiplication = Multiplication(A=subtraction_2, B=panel)
multiplication_2 = Multiplication(A=division_3, B=panel)

stream_filter = StreamFilter(Gate=기부채납_건물_임대_선택, Stream0=panel_6, Stream1=panel_7)

# ----
# 기부채납 대지 분할
division_4 = Division(A=대지_기부채납_비율, B=100)
python_3_script = Python3Script(C=flatten(geometry), p=flatten(division_4), C_cut=flatten(geometry_2))  # -> a, b; inputs C: Curve, p: Double, C_cut: Curve
# ---------- python_3_script: Python ----------
import Rhino.Geometry as rg

def split_land_curve_boolean(boundary, reference_line, ratio):
    # 1. 안전한 데이터 추출
    b_crv = boundary[0] if isinstance(boundary, (list, tuple)) else boundary
    ref_line = reference_line[0] if isinstance(reference_line, (list, tuple)) else reference_line
    
    # 2. 초기 대지 면적 산출
    base_breps = rg.Brep.CreatePlanarBreps(b_crv, 0.001)
    if not base_breps: return [], [], None
    target_area = base_breps[0].GetArea() * ratio
    
    # 3. 방향 벡터 추출
    line_vec = ref_line.PointAtEnd - ref_line.PointAtStart
    line_vec.Z = 0
    line_vec.Unitize()
    
    move_dir = rg.Vector3d.CrossProduct(line_vec, rg.Vector3d.ZAxis)
    move_dir.Unitize()
    if move_dir.Y > 0: move_dir.Reverse() 
    
    # 4. 탐색 범위 설정
    bbox = b_crv.GetBoundingBox(True)
    diag = bbox.Max.DistanceTo(bbox.Min)
    start_pt = bbox.Center - (move_dir * diag)
    
    low = 0.0
    high = diag * 2.5
    
    res_a, res_b, res_line = [], [], None
    
    for i in range(40):
        mid = (low + high) / 2.0
        current_pt = start_pt + (move_dir * mid)
        
        # [최종 해결 핵심] Brep 자르기가 아닌 선(Curve) 기반의 부울 연산 사용!
        # 북측(a 영역)을 덮는 거대한 사각형 컵(Cutter Rectangle) 생성
        p1 = current_pt - line_vec * (diag * 2.0)
        p2 = current_pt + line_vec * (diag * 2.0)
        p3 = p2 - move_dir * (diag * 2.0)
        p4 = p1 - move_dir * (diag * 2.0)
        north_rect = rg.Polyline([p1, p2, p3, p4, p1]).ToNurbsCurve()
        
        # 선(Curve)끼리 교차하여 완벽하게 깨끗한 폐곡선 추출
        a_crvs = rg.Curve.CreateBooleanIntersection(b_crv, north_rect, 0.001)
        b_crvs = rg.Curve.CreateBooleanDifference(b_crv, north_rect, 0.001)
        
        if a_crvs and b_crvs:
            # 추출된 깨끗한 폐곡선을 다시 튼튼한 면(Brep)으로 생성
            a_breps = rg.Brep.CreatePlanarBreps(a_crvs, 0.001)
            b_breps = rg.Brep.CreatePlanarBreps(b_crvs, 0.001)
            
            if a_breps and b_breps:
                current_a_area = sum([br.GetArea() for br in a_breps])
                
                # 데이터 업데이트 (null 없이 완벽한 면만 저장됨)
                res_a = a_breps
                res_b = b_breps
                
                # 시각화용 절단선 추출
                plane = rg.Plane(current_pt, line_vec, rg.Vector3d.ZAxis)
                iterc = rg.Intersect.Intersection.CurvePlane(b_crv, plane, 0.001)
                if iterc and len(iterc) >= 2:
                    pts = [ev.PointA for ev in iterc]
                    pts.sort(key=lambda p: (p - current_pt) * line_vec)
                    res_line = rg.LineCurve(pts[0], pts[-1])
                
                if current_a_area < target_area:
                    low = mid
                else:
                    high = mid
            else:
                low = mid
        else:
            low = mid
            
    return res_a, res_b, res_line

# --- 실행부 ---
if C is not None and C_cut is not None and p is not None:
    ratio_val = p[0] if isinstance(p, (list, tuple)) else p
    actual_ratio = ratio_val if ratio_val <= 1.0 else ratio_val / 100.0
    
    out_a, out_b, out_line = split_land_curve_boolean(C, C_cut, actual_ratio)
    
    a = list(out_a) if out_a else []
    b = list(out_b) if out_b else []
    crv = out_line
# ---------- end python_3_script ----------
geometry_27 = Geometry(python_3_script.b)
unit_z = UnitZ(Factor="300")
extrude = Extrude(Base=geometry_27, Direction=unit_z)

기부채납_후_대지면적 = Data(multiplication)

boundary_surfaces = BoundarySurfaces(Edges=geometry)
unit_z_2 = UnitZ(Factor="150")
extrude_2 = Extrude(Base=boundary_surfaces, Direction=unit_z_2)

panel_9 = Panel(geometry_27)
panel_10 = Panel(multiplication_2)

python_3_script_2 = Python3Script(x=panel_10, A=panel, M=stream_filter, N=panel_4, K=division_2, R=division)  # -> out, y; inputs x: Double, A: Double, M: Double, N: Double, K: Double, R: Double
# ---------- python_3_script_2: Python ----------
"""그래스호퍼용 건축물 기부채납 면적(y) 산출 스크립트 (비율 가변형)
    Inputs:
        x: 부지 기부채납 대지면적
        A: 대지면적
        M: 공사비
        N: 토지비
        K: 용적률
        R: 기부채납 비율 (예: 15%일 경우 0.15 입력)
    Output:
        y: 건축물 기부채납 면적
"""

import math

def calculate_y(x, A, M, N, K, R):
    # 모든 입력값이 들어왔는지 확인
    inputs = [x, A, M, N, K, R]
    if any(v is None for v in inputs):
        return None
    
    # 0으로 나누기 방지
    if N == 0 or K == 0:
        return "Error: N or K cannot be zero"
    
    # 공식 정리: y = (R*A - x) / (M/N + 0.63/K)
    # 여기서 0.15 대신 입력받은 R을 사용합니다.
    numerator = (R * A) - x
    denominator = (M / N) + (0.63 / K)
    
    if denominator == 0:
        return "Error: Denominator is zero"
        
    result = numerator / denominator
    return result

# 그래스호퍼 출력 변수 y에 결과 할당
y_raw = calculate_y(x, A, M, N, K, R)
if isinstance(y_raw, (int, float)):
    y = round(y_raw, 2)
else:
    y = y_raw
# ---------- end python_3_script_2 ----------

# ----
# 기부채납 건축물 순부담(최소 순부담 15% 중 대지 기부채납 부족분)에 따른 연면적
임대주택_기부채납_연면적 = Data(python_3_script_2.y)
multiplication_3 = Multiplication(A=임대주택_기부채납_연면적, B="0.63")
division_5 = Division(A=multiplication_3, B=기부채납_후_대지면적)
multiplication_4 = Multiplication(A=division_5, _100=100)
panel_11 = Panel(임대주택_기부채납_연면적)
panel_12 = Panel(multiplication_4)

임대주택_기부채납_연면적_2 = Data(python_3_script_2.y)

python_3_script_3 = Python3Script(x=panel_10, A=panel, M=stream_filter, N=panel_4, K=division_2, y=python_3_script_2.y)  # -> out, result; inputs x: Double, A: Double, M: Double, N: Double, K: Double, y: Double
# ---------- python_3_script_3: Python ----------
"""이미지의 복잡한 공식을 단순화하여 계산하는 스크립트
    Inputs:
        x: 부지 기부채납 대지면적
        y: 건축물 기부채납 면적
        A: 대지면적
        M: 공사비
        N: 토지비
        K: 용적률
    Output:
        result: 공식의 최종 결과값
"""

def calculate_complex_formula(x, y, A, M, N, K):
    # 입력값 누락 확인
    if any(v is None for v in [x, y, A, M, N, K]):
        return None

    # 0으로 나누기 방지 및 분모 0 체크
    if N == 0 or K == 0:
        return "Error: N or K cannot be zero"
    
    # 식의 공통 부분: (A - x) - (0.63 * y / K)
    # 이미지에서 약분된 분모의 핵심 요소입니다.
    common_denominator = (A - x) - (0.63 * y / K)
    
    if common_denominator == 0:
        return "Error: Common denominator is zero"

    # 1. 분자 부분 정리 (1.3 * (x + 0.63*y/K) + y*M/N)
    numerator_part = 1.3 * (x + (0.63 * y / K)) + (y * M / N)
    
    # 2. 전체 식 조립: 1 + (분자 / 분모)
    # 이미지 우측 하단의 + (y*M/N)/... 부분까지 통합된 형태입니다.
    final_val = (numerator_part / common_denominator)
    
    return final_val

# 결과 출력
result = calculate_complex_formula(x, y, A, M, N, K)
# ---------- end python_3_script_3 ----------

multiplication_5 = Multiplication(A=python_3_script_3.result, B=허용_용적률)
multiplication_6 = Multiplication(A=임대주택_기부채납_연면적_2, B="0.63")

subtraction_3 = Subtraction(상한용적=panel_3, 허용용적=허용_용적률, 타법령용적상승=타_법령에_의한_완화_용적, 대지기부채납=multiplication_5)
panel_13 = Panel(subtraction_3)
division_6 = Division(A=subtraction_3, B=2)

division_7 = Division(A=multiplication_6, B=기부채납_후_대지면적)
기부채납_임대_면적 = Panel(python_3_script_2.y)
순부담_용적_계수_x1_3 = Panel(python_3_script_3.result)
순부담에_따른_용적률_상승분 = Panel(multiplication_5)
panel_14 = Panel(multiplication)

# ----
# 기부채납 임대 순부담(최소 순부담 15% 중 대지 기부채납 부족분)에 따른 연면적
multiplication_7 = Multiplication(A=division_7, _100=100)
panel_15 = Panel(multiplication_7)
panel_16 = Panel(임대주택_기부채납_연면적_2)

공급_임대주택_용적 = Data(division_6)

colour_swatch = ColourSwatch(SwatchColor=RGB(229, 230, 207))
custom_preview = CustomPreview(Geometry=extrude, Material=colour_swatch)

colour_swatch_2 = ColourSwatch(SwatchColor=RGB(140, 255, 161))
custom_preview_2 = CustomPreview(Geometry=extrude_2, Material=colour_swatch_2)

임대주택_기부채납에_따른_용적_상승분 = Data(panel_15)
건축물_기부채납에_따른_용적_상승분 = Data(panel_12)
임대주택_기부채납_연면적_3 = Data(panel_16)
건축물_기부채납_연면적 = Data(panel_11)
stream_filter_2 = StreamFilter(Gate=기부채납_건물_임대_선택, Stream0=임대주택_기부채납_연면적_3)
stream_filter_3 = StreamFilter(Gate=기부채납_건물_임대_선택, Stream1=건축물_기부채납_연면적)
stream_filter_4 = StreamFilter(Gate=기부채납_건물_임대_선택, Stream0=임대주택_기부채납에_따른_용적_상승분, Stream1=건축물_기부채납에_따른_용적_상승분)
임대주택_건축_기부채납_연면적 = Data(stream_filter_2)
임대주택_건축_기부채납_연면적_2 = Data(stream_filter_3)
임대주택_기부채납에_따른_용적_상승분_2 = Data(stream_filter_4)

기부채납_후_대지면적_2 = Data(multiplication)

# ----
# 건축물 기부채납
panel_17 = Panel(임대주택_건축_기부채납_연면적_2)
division_8 = Division(A=panel_17, B="0.63")
round = Round(Number=division_8)  # -> Nearest, Floor, Ceiling

# ----
# 기부채납 임대분 세대수
panel_18 = Panel("0.725")
임대_기부채납_연면적 = Data(임대주택_건축_기부채납_연면적)
multiplication_8 = Multiplication(A=임대_기부채납_연면적, B=panel_18)
integer_division = IntegerDivision(A=multiplication_8, B="59.9")
round_2 = Round(Number=integer_division)  # -> Nearest, Floor, Ceiling

# ----
# 공급 임대분 세대수
division_9 = Division(A=공급_임대주택_용적, _100=100)
multiplication_9 = Multiplication(A=기부채납_후_대지면적_2, B=division_9)
multiplication_10 = Multiplication(A=multiplication_9, B="0.725")
panel_19 = Panel(multiplication_9)
division_10 = Division(A=multiplication_10, B="59.9")
round_3 = Round(Number=division_10)  # -> Nearest, Floor, Ceiling

stream_filter_5 = StreamFilter(Gate=기부채납_건물_임대_선택, Stream0=임대주택_기부채납_연면적_3)
stream_filter_6 = StreamFilter(Gate=기부채납_건물_임대_선택, Stream1=panel_17)
panel_20 = Panel(round_3.Floor)
panel_21 = Panel(round_2.Floor)

multiplication_11 = Multiplication(A=stream_filter_6, B="0.3025")
일반건축_공사비 = Data(비주거_평당_공사비)
division_11 = Division(A=multiplication_11, B="0.63")
multiplication_12 = Multiplication(A=division_11, B=일반건축_공사비)
division_12 = Division(A=multiplication_12, _10=10)
panel_22 = Panel(division_12)

# ----
# 전체 용적 세대수
기부채납_후_대지면적_3 = Data(기부채납_후_대지면적_2)
cluster = Cluster(A=기부채납_후_대지면적_3)
panel_23 = Panel(cluster)

# ----
# 건축물 기부채납 연면적
panel_24 = Panel(round.Floor)
division_13 = Division(A=panel_4, B=1000000)
multiplication_13 = Multiplication(A=주거_평당_공사비, B=10)
round_4 = Round(Number=division_13)  # -> Nearest, Floor, Ceiling
concatenate = Concatenate(Fragment_A="순부담 임대 세대수 [", Fragment_B=panel_21, A="세대]")  # -> flatten(Result)
concatenate_2 = Concatenate(Fragment_A="건축물 순부담비율 [", Fragment_B=panel_8, A="%]")  # -> flatten(Result)
concatenate_3 = Concatenate(Fragment_A="공급 임대 세대수 [", Fragment_B=panel_20, A="세대]")  # -> flatten(Result)
concatenate_4 = Concatenate(Fragment_A="대지 순부담비율 [", Fragment_B=대지_기부채납_비율, A="%]")  # -> flatten(Result)
concatenate_5 = Concatenate(Fragment_A="순부담 건축물 [", Fragment_B=panel_24, A="㎡]")  # -> flatten(Result)
concatenate_6 = Concatenate(Fragment_A="토지비 [약", Fragment_B=round_4.Floor, A="백만원]")  # -> flatten(Result)
concatenate_7 = Concatenate(Fragment_A="주거 건축비 [약", Fragment_B=multiplication_13, A="백만원]")  # -> flatten(Result)
stream_filter_7 = StreamFilter(Gate=기부채납_건물_임대_선택, Stream0=concatenate, Stream1=concatenate_5)

panel_25 = Panel(round_2.Floor)
panel_26 = Panel(round_3.Floor)
division_14 = Division(A=최고_높이, B=층고)
round_5 = Round(Number=division_14)  # -> Nearest, Floor, Ceiling
multiplication_14 = Multiplication(A=층고, _1000=1000)
panel_27 = Panel(round_5.Floor)
addition = Addition(A=round_5.Floor, B=1)
python_3_script_4 = Python3Script(base_curves=merge, max_floors=addition, height=multiplication_14)  # -> out, flatten(a); inputs base_curves: list of Curve, max_floors: Int32, height: Double
# ---------- python_3_script_4: Python ----------
import Rhino.Geometry as rg
import Grasshopper as gh
from Grasshopper.Kernel.Data import GH_Path

def stack_towers_simple():
    # 결과를 담을 데이터 트리
    output_tree = gh.DataTree[rg.GeometryBase]()
    
    if not base_curves: return output_tree

    # 1. 각 베이스 커브를 순회 (리스트의 0번부터 순서대로)
    for i, base_crv in enumerate(base_curves):
        # 각 커브(동)마다 개별 브랜치 생성 {0}, {1}, {2}...
        path = GH_Path(i)
        
        # 2. 지정된 최고 층수만큼 반복해서 쌓기
        for f in range(max_floors):
            # 수직 이동 벡터 계산 (Z축 방향)
            # f=0 이면 바닥, f=1 이면 1층 높이...
            move_vec = rg.Vector3d(0, 0, f * height)
            
            # 베이스 커브 복제 및 위로 이동
            moved_crv = base_crv.Duplicate()
            moved_crv.Translate(move_vec)
            
            # 이동된 커브를 기반으로 박스(Extrusion) 생성
            # 높이는 입력받은 height만큼 돌출
            box = rg.Extrusion.Create(moved_crv, height, True)
            
            # 생성된 박스를 해당 커브의 브랜치에 추가
            output_tree.Add(box, path)

    return output_tree

# 출력 포트 'a'에 결과 할당
a = stack_towers_simple()
# ---------- end python_3_script_4 ----------
tree_branch = TreeBranch(Tree=python_3_script_4.a, Path="{0}", MaintainPaths=True)

colour_swatch_3 = ColourSwatch(SwatchColor=RGBA(213, 233, 237, 206))
colour_swatch_4 = ColourSwatch(SwatchColor=RGB(245, 157, 157))
colour_swatch_5 = ColourSwatch(SwatchColor=RGB(255, 243, 168))
colour_swatch_6 = ColourSwatch(SwatchColor=RGBA(145, 145, 145, 206))
custom_preview_3 = CustomPreview(Geometry=tree_branch, Material=colour_swatch_6)

# ----
# 분양분 세대수
subtraction_4 = Subtraction(A=panel_3, B=공급_임대주택_용적, C=임대주택_기부채납에_따른_용적_상승분_2)
division_15 = Division(A=subtraction_4, B=100)
multiplication_15 = Multiplication(A=기부채납_후_대지면적_2, B=division_15)
panel_28 = Panel(multiplication_15)

subtraction_5 = Subtraction(A=multiplication_15, B=panel_2)

multiplication_16 = Multiplication(A=subtraction_5, B="0.725")
division_16 = Division(A=multiplication_16, B="59.9")
round_6 = Round(Number=division_16)  # -> Nearest, Floor, Ceiling

panel_29 = Panel(round_6.Floor)
merge_3 = Merge(Data1=panel_29, Data2=panel_26, Data3=panel_25)  # -> flatten(Result)
panel_30 = Panel(merge_3)
python_3_script_5 = Python3Script(base_curves=merge_2, counts=panel_30, max_floors=round_5.Floor, height=multiplication_14)  # -> out, a; inputs base_curves: list of Curve, counts: list of Int32, max_floors: Int32, height: Double
# ---------- python_3_script_5: Python ----------
import Rhino.Geometry as rg
import Grasshopper as gh
from Grasshopper.Kernel.Data import GH_Path
import math

def create_hybrid_balanced_towers():
    output_tree = gh.DataTree[rg.GeometryBase]()
    if not base_curves or not counts: return output_tree

    gap = 0.0 
    num_curves = len(base_curves)
    
    # 1. 0번 리스트의 전용 동 개수 계산
    full_towers_0 = int(counts[0] // max_floors)
    rem_0 = counts[0] % max_floors
    
    # 2. 혼합 동에 들어갈 데이터 정리
    # 혼합 동 리스트 구성: [0번 나머지, 1번 전체, 2번 전체]
    hybrid_counts = [rem_0, counts[1], counts[2]]
    total_hybrid_units = sum(hybrid_counts)
    
    # 혼합 동이 필요한 개수
    num_hybrid_towers = int(math.ceil(float(total_hybrid_units) / max_floors))
    
    # 3. 전체 배치 계획 수립 (tower_map[동_인덱스] = [(리스트_ID, 높이비율)])
    tower_map = [[] for _ in range(num_curves)]
    
    # A. 0번 전용 동 배치
    for t_idx in range(full_towers_0):
        if t_idx >= num_curves: break
        for f in range(int(max_floors)):
            tower_map[t_idx].append((0, 1.0))
            
    # B. 혼합 동 수평 균등 배분 (나머지 동들 대상)
    start_hybrid_idx = full_towers_0
    end_hybrid_idx = start_hybrid_idx + num_hybrid_towers
    
    # 가용한 혼합 동 실제 개수 (베이스 커브 한계 고려)
    actual_hybrid_cols = min(num_curves - start_hybrid_idx, num_hybrid_towers)
    
    if actual_hybrid_cols > 0:
        # 하부(2) -> 중간(1) -> 상부(0의 나머지) 순서로 바닥부터 쌓기
        hybrid_order = [2, 1, 0] # 혼합 동 내의 적층 순서
        
        # 현재 각 혼합 동의 층수 추적
        hybrid_floor_tracker = [0] * actual_hybrid_cols
        
        for h_list_idx in hybrid_order:
            unit_count = float(hybrid_counts[h_list_idx])
            if unit_count <= 0: continue
            
            # 현재 리스트의 유닛들을 혼합 동들 사이에 수평 배분
            avg_per_h_tower = unit_count / actual_hybrid_cols
            
            for h_t_idx in range(actual_hybrid_cols):
                abs_t_idx = start_hybrid_idx + h_t_idx
                remaining_to_dist = avg_per_h_tower
                
                while remaining_to_dist > 0:
                    if hybrid_floor_tracker[h_t_idx] >= max_floors: break
                    
                    fraction = min(1.0, remaining_to_dist)
                    # 실제 counts 리스트에서의 인덱스로 변환 (hybrid_counts [0,1,2] -> 원래 인덱스 [0,1,2])
                    orig_idx = h_list_idx 
                    
                    tower_map[abs_t_idx].append((orig_idx, fraction))
                    hybrid_floor_tracker[h_t_idx] += 1
                    remaining_to_dist -= 1.0

    # 4. 지오메트리 생성
    for t_idx, units in enumerate(tower_map):
        if t_idx >= num_curves or not units: continue
        base_crv = base_curves[t_idx]
        
        for f_idx, (l_idx, fraction) in enumerate(units):
            move_vec = rg.Vector3d(0, 0, f_idx * height)
            m_crv = base_crv.Duplicate()
            m_crv.Translate(move_vec)
            
            h_calc = (height * fraction) - gap
            box = rg.Extrusion.Create(m_crv, max(10.0, h_calc), True)
            output_tree.Add(box, GH_Path(l_idx))

    return output_tree

a = create_hybrid_balanced_towers()
# ---------- end python_3_script_5 ----------

tree_branch_2 = TreeBranch(Tree=python_3_script_5.a, Path="{0}", MaintainPaths=True)
tree_branch_3 = TreeBranch(Tree=python_3_script_5.a, Path="{1}", MaintainPaths=True)
tree_branch_4 = TreeBranch(Tree=python_3_script_5.a, Path="{2}", MaintainPaths=True)
custom_preview_4 = CustomPreview(Geometry=tree_branch_2, Material=colour_swatch_3)
custom_preview_5 = CustomPreview(Geometry=tree_branch_3, Material=colour_swatch_4)
custom_preview_6 = CustomPreview(Geometry=tree_branch_4, Material=colour_swatch_5)

webpublishlatestv1 = WebPublishLatestV1(
    mass_a=extrude,
    color_a=colour_swatch,
    mass_b=extrude_2,
    color_b=colour_swatch_2,
    mass_c=tree_branch_2,
    color_c=colour_swatch_3,
    mass_d=tree_branch_3,
    color_d=colour_swatch_4,
    mass_e=tree_branch_4,
    color_e=colour_swatch_5,
    mass_f=tree_branch,
    color_f=colour_swatch_6)  # -> model_path, manifest_path, published_count, out; inputs mass_a: list, mass_b: list, mass_c: list, mass_d: list, mass_e: list, mass_f: list
#   port mass_a: Preview geometry set A
#   port color_a: Preview color A
#   port mass_b: Preview geometry set B
#   port color_b: Preview color B
#   port mass_c: Preview geometry set C
#   port color_c: Preview color C
#   port mass_d: Preview geometry set D
#   port color_d: Preview color D
#   port mass_e: Preview geometry set E
#   port color_e: Preview color E
#   port mass_f: Preview geometry set F
#   port color_f: Preview color F
#   port model_path: Published model path
#   port manifest_path: Published manifest path
#   port published_count: Number of exported preview objects
#   port out: Status and log output
# ---------- webpublishlatestv1: Python ----------
from __future__ import annotations

import json
from datetime import datetime
from pathlib import Path

import Rhino
import System
import System.Drawing


SOURCE_DEFS = [
    ('5f38a628-b176-4b96-9f12-670b34c5c8df', 0, '7e77f9e3-37de-4ee2-a59c-0d1fd002e42d', 'mass_a'),
    ('0641faa2-7fa8-4de3-ba79-a5d61d684b3d', 0, '11ae7d25-5861-4857-a4c8-032365da6eb3', 'mass_b'),
    ('bf993c93-6d7d-49a0-abed-d6194bf75215', 0, '52d3ea36-151a-48b7-b33b-2f9c1599ee7d', 'mass_c'),
    ('844fd258-1548-45c1-84d5-edc0018745bf', 0, 'b197e278-6997-4c51-b5d8-b841ff98fe42', 'mass_d'),
    ('4ad8d022-b054-4b17-8ca5-3d5c059989c8', 0, '8a9c7238-74dc-4af2-976a-dc90c36c425e', 'mass_e'),
    ('d76dc63d-8094-42f4-9f9d-fa7d18c8a923', 0, '8cae1070-d3f3-47f8-bd83-6151b0e29f6b', 'mass_f'),
]
PUBLISHED_MODEL_NAME = 'current-preview.3dm'


def _unwrap(item):
    if item is None:
        return None
    try:
        sv = item.ScriptVariable()
        if sv is not None:
            return sv
    except Exception:
        pass
    try:
        val = item.Value
        if val is not None:
            return val
    except Exception:
        pass
    return item


def _coerce_color(value):
    value = _unwrap(value)
    if value is None:
        return System.Drawing.Color.FromArgb(235, 235, 235)
    if isinstance(value, System.Drawing.Color):
        return value
    try:
        return System.Drawing.Color.FromArgb(value)
    except Exception:
        return System.Drawing.Color.FromArgb(235, 235, 235)


def _clone_geometry(doc, item):
    item = _unwrap(item)
    if item is None:
        return None
    if isinstance(item, System.Guid):
        rh_obj = doc.Objects.FindId(item)
        if rh_obj is not None and rh_obj.Geometry is not None:
            return rh_obj.Geometry.Duplicate()
        return None
    try:
        dup = item.Duplicate()
        if dup is not None:
            return dup
    except Exception:
        pass
    try:
        dup = item.DuplicateGeometry()
        if dup is not None:
            return dup
    except Exception:
        pass
    try:
        brep = item.ToBrep()
        if brep is not None:
            return brep
    except Exception:
        pass
    return None


def _meshify_geometry(geo):
    geo = _unwrap(geo)
    if geo is None:
        return []

    if isinstance(geo, Rhino.Geometry.Mesh):
        dup = geo.DuplicateMesh()
        if dup is not None:
            dup.Normals.ComputeNormals()
            dup.Compact()
            return [dup]
        return []

    brep = None
    if isinstance(geo, Rhino.Geometry.Extrusion):
        try:
            brep = geo.ToBrep(True)
        except Exception:
            brep = None
    elif isinstance(geo, Rhino.Geometry.Brep):
        brep = geo.DuplicateBrep()
    else:
        try:
            brep = geo.ToBrep()
        except Exception:
            brep = None

    if brep is None:
        return []

    params = Rhino.Geometry.MeshingParameters.FastRenderMesh
    try:
        meshes = Rhino.Geometry.Mesh.CreateFromBrep(brep, params)
    except Exception:
        meshes = None

    if not meshes:
        return []

    joined = Rhino.Geometry.Mesh()
    for mesh in meshes:
        if mesh is None:
            continue
        joined.Append(mesh)

    if joined.Faces.Count == 0:
        return []

    joined.Normals.ComputeNormals()
    joined.Compact()
    return [joined]


def _project_root_from_doc(doc_path):
    model_dir = Path(doc_path).resolve().parent
    return model_dir.parent.parent


def _iso_now():
    return datetime.now().astimezone().isoformat(timespec='seconds')


def _find_gh_object(gh_doc, guid_text):
    gid = System.Guid(guid_text)
    for obj in gh_doc.Objects:
        if obj.InstanceGuid == gid:
            return obj
    return None


def _collect_from_source_defs(rh_doc, gh_doc):
    collected = []
    skipped = 0
    labels = []
    for owner_guid, output_index, color_guid, label in SOURCE_DEFS:
        owner = _find_gh_object(gh_doc, owner_guid)
        color_obj = _find_gh_object(gh_doc, color_guid)
        if owner is None:
            labels.append('missing owner {}'.format(label))
            continue
        color = System.Drawing.Color.FromArgb(235, 235, 235)
        try:
            color_branch = color_obj.VolatileData.get_Branch(0)
            if color_branch is not None and color_branch.Count > 0:
                color = _coerce_color(color_branch[0])
        except Exception:
            pass
        try:
            branch = owner.Params.Output[output_index].VolatileData.get_Branch(0)
        except Exception:
            branch = None
        if branch is None:
            labels.append('empty {}'.format(label))
            continue
        local_count = 0
        for item in branch:
            geo = _clone_geometry(rh_doc, item)
            meshes = _meshify_geometry(geo)
            if not meshes:
                skipped += 1
                continue
            for mesh in meshes:
                collected.append((mesh, color, label))
                local_count += 1
        labels.append('{}={}'.format(label, local_count))
    return collected, skipped, labels


log_lines = []
model_path = ''
manifest_path = ''
published_count = 0
out = ''

try:
    rh_doc = Rhino.RhinoDoc.ActiveDoc
    if rh_doc is None or not rh_doc.Path:
        raise RuntimeError('Active Rhino document path is missing.')

    import Grasshopper
    gh_doc = Grasshopper.Instances.ActiveCanvas.Document if Grasshopper.Instances.ActiveCanvas else None
    if gh_doc is None:
        raise RuntimeError('Active Grasshopper document is missing.')

    project_root = _project_root_from_doc(rh_doc.Path)
    output_dir = project_root / 'output' / 'latest'
    output_dir.mkdir(parents=True, exist_ok=True)

    collected, skipped_total, labels = _collect_from_source_defs(rh_doc, gh_doc)
    if not collected:
        raise RuntimeError('No preview geometry was collected from source defs. ' + ', '.join(labels))

    model = Rhino.FileIO.File3dm()
    model.Settings.ModelUnitSystem = rh_doc.ModelUnitSystem
    model.Settings.ModelAbsoluteTolerance = rh_doc.ModelAbsoluteTolerance
    model.Settings.ModelAngleToleranceDegrees = rh_doc.ModelAngleToleranceDegrees

    added = 0
    for geo, color, label in collected:
        attr = Rhino.DocObjects.ObjectAttributes()
        attr.Name = 'GH_WEB_PREVIEW_' + label
        attr.ObjectColor = color
        attr.ColorSource = Rhino.DocObjects.ObjectColorSource.ColorFromObject
        model.Objects.Add(geo, attr)
        added += 1

    target_model = output_dir / PUBLISHED_MODEL_NAME
    if target_model.exists():
        target_model.unlink()
    if not model.Write(str(target_model), 8):
        raise RuntimeError('Failed to write published 3dm file.')

    manifest = {
        'version': 1,
        'updated_at': _iso_now(),
        'format': '3dm',
        'model_path': '../output/latest/' + PUBLISHED_MODEL_NAME,
        'source': {
            'gh_file': str(project_root / 'rhino' / 'grasshopper' / '260402_기부채납 비율 검토 _ 타워.gh'),
            'notes': 'Published directly from Grasshopper preview geometry only'
        },
        'camera': {
            'mode': 'rhino_perspective'
        }
    }

    manifest_file = output_dir / 'manifest.json'
    manifest_file.write_text(json.dumps(manifest, ensure_ascii=False, indent=2) + '\n', encoding='utf-8')

    model_path = str(target_model)
    manifest_path = str(manifest_file)
    published_count = added
    log_lines.append('Published preview geometry count: {}'.format(added))
    log_lines.append('Skipped non-geometry items: {}'.format(skipped_total))
    log_lines.append('Sources: {}'.format(', '.join(labels)))
    log_lines.append('Model: {}'.format(model_path))
    log_lines.append('Manifest: {}'.format(manifest_path))
except Exception as exc:
    log_lines.append('ERROR: {}'.format(exc))

out = '\n'.join(log_lines)
# ---------- end webpublishlatestv1 ----------
panel_31 = Panel(round_6.Floor)

addition_2 = Addition(A=panel_28, B=panel_19, C=stream_filter_5)
분양가 = Data(_59type_세대당_분양가)
multiplication_17 = Multiplication(A=addition_2, B="0.3025")
주택_공사비 = Data(주거_평당_공사비)
multiplication_18 = Multiplication(A=panel_31, B=분양가)
panel_32 = Panel(multiplication_17)
division_17 = Division(A=multiplication_17, B="0.63")
panel_33 = Panel(multiplication_18)
panel_34 = Panel(division_17)
multiplication_19 = Multiplication(A=주택_공사비, B=division_17)
division_18 = Division(A=multiplication_19, _10=10)
panel_35 = Panel(division_18)
addition_3 = Addition(A=division_18, B=division_12)
subtraction_6 = Subtraction(A=multiplication_18, B=addition_3)

addition_4 = Addition(A=panel_31, B=panel_20, C=panel_21)
# 총 세대수
panel_36 = Panel(addition_4)
분양_수익 = Data(subtraction_6)
공사비 = Data(addition_3)
round_7 = Round(Number=분양_수익)  # -> Nearest, Floor, Ceiling
round_8 = Round(Number=공사비)  # -> Nearest, Floor, Ceiling
panel_37 = Panel(round_7.Floor)
panel_38 = Panel(round_8.Floor)
subtraction_7 = Subtraction(A=panel_37, B=panel_38)
concatenate_8 = Concatenate(Fragment_A="분양 세대수 [", Fragment_B=panel_31, A="세대]")  # -> flatten(Result)
concatenate_9 = Concatenate(Fragment_A="총 세대수 [", Fragment_B=panel_36, A="세대]")  # -> flatten(Result)
concatenate_10 = Concatenate(Fragment_A="분양 매출 [약", Fragment_B=panel_37, A="억원]")  # -> flatten(Result)
concatenate_11 = Concatenate(Fragment_A="공사비 [약", Fragment_B=panel_38, A="억원]")  # -> flatten(Result)
concatenate_12 = Concatenate(Fragment_A="매출-공사비 [약", Fragment_B=subtraction_7, A="억원]")  # -> flatten(Result)
merge_4 = Merge(
    Data1="SUMMARY",
    Data2="----------------------",
    Data3=concatenate_4,
    Data4=concatenate_2,
    Data5="----------------------",
    Data6=concatenate_9,
    Data7=concatenate_8,
    Data8=concatenate_3,
    Data9=stream_filter_7,
    Data10="----------------------",
    Data11=concatenate_6,
    Data12=concatenate_7,
    Data15="----------------------",
    Data16=concatenate_10,
    Data17=concatenate_11,
    Data18=concatenate_12,
    Data19="----------------------")  # -> flatten(Result)

hud = Python3Script(data_list=merge_4, color=ColourSwatch(SwatchColor=RGB(222, 0, 0)), size=Slider(26, range=0..50), run=Toggle(True))  # -> out, out_2; inputs data_list: list, size: Int32, run: Boolean
# ---------- hud: Python ----------
import Rhino
import System.Drawing
import scriptcontext as sc
from Rhino.Display import DisplayConduit

# 고유 키
key = "FINAL_R8_OVERLAY_HUD"

class OverlayHUD(DisplayConduit):
    def __init__(self, texts, color_val, size_val):
        super().__init__()
        self.texts = [str(t) for t in texts] if isinstance(texts, list) else [str(texts)]
        self.color = color_val if color_val else System.Drawing.Color.Magenta
        self.size = int(size_val) if (size_val and size_val > 5) else 30
        self.font = "-윤고딕340"

    # [가장 강력함] 모든 객체와 뷰포트 설정을 무시하고 맨 위에 그립니다.
    def DrawOverlay(self, e):
        try:
            vp = e.Viewport
            w = vp.Bounds.Width
            
            # 우측 상단 좌표 고정 (레이어창 가림 방지를 위해 왼쪽으로 많이 당김)
            x_pos = w - 450 
            start_y = 100
            line_gap = self.size * 1.5
            
            for i, txt in enumerate(self.texts):
                e.Display.Draw2dText(
                    txt, self.color, 
                    Rhino.Geometry.Point2d(x_pos, start_y + (i * line_gap)), 
                    False, self.size, self.font
                )
        except: pass

# --- 청소 로직 ---
def cleanup():
    all_keys = list(sc.sticky.keys())
    for k in all_keys:
        if "HUD" in str(k) or "R8" in str(k):
            try:
                sc.sticky[k].Enabled = False
            except: pass
            del sc.sticky[k]

cleanup()

# --- 실행부 ---
if 'run' in globals() and run and 'data_list' in globals() and data_list:
    try:
        c = OverlayHUD(data_list, color, size)
        c.Enabled = True
        sc.sticky[key] = c
        Rhino.RhinoDoc.ActiveDoc.Views.Redraw()
        out = "HUD FORCED OVERLAY"
    except Exception as e:
        out = str(e)
else:
    Rhino.RhinoDoc.ActiveDoc.Views.Redraw()
    out = "HUD OFF"
# ---------- end hud ----------

panel_39 = Panel(merge_4)

# ==== cluster Cluster
A = ClusterInput()
multiplication = Multiplication(A=A, B=4)
multiplication_2 = Multiplication(A=multiplication, B="0.725")
division = Division(A=multiplication_2, B="59.9")
round = Round(Number=division)  # -> Nearest, Floor, Ceiling
panel = Panel(multiplication)
floor = ClusterOutput(round.Floor)
